vi "BPSK_Tx_Rx_Template.gvi"   [LabVIEW NXG 5.0.0]
panel controls:
  "IQ rate": f64 = 200000
  "device names": "USRP niUSRPClass"
  "carrier frequency": f64 = 400000000
  "gain Tx": f64
  "active antenna Tx": string = "TX1"
  "stop Tx": bool
  "gain Rx": f64
  "active antenna Rx": string = "RX2"
  "total bits": i32 = 128
panel indicators:
  "Baseband Waveform": waveform<c128>
  "Baseband Power Spectrum_Tx": T1
  "Baseband Power Spectrum_Rx": T1
types:
  T1 = cluster{"f0": f64, "df": f64, "magnitude": f64[]}
uses:
  NI::USRP::niUSRP Open Rx Session.gvi
  NI::USRP::niUSRP Configure Signal.gvi
  NI::USRP::niUSRP Initiate.gvi
  NI::USRP::niUSRP Fetch Rx Data (CDB).gvi
  NI::USRP::niUSRP Close Session.gvi
  NI::USRP::niUSRP Open Tx Session.gvi
  NI::Modulation::MT Generate Bits (Galois, PN Order).gvi
  NI::Analysis::Resampling::Upsample (DBL).gvi
  NI::Modulation::MT Generate Filter Coefficients.gvi
  NI::Analysis::Operations::1D Convolution (DBL).gvi
  NI::USRP::niUSRP Write Tx Data (CDB).gvi
diagram:
  w1 = cluster{"t0": timestamp, "dt": f64, "Y": c128[]} {all zero or empty}
  Property Node(instance in=w1, "dt"=0.1, "Y"=c128[] []) -> (instance out=w2)
  call "FFT Power Spectrum for 1 Chan (CDB)2.gvi"(time signal=w2, dB On (F)=TRUE) -> (power spectrum=w3)
  $"Baseband Power Spectrum_Rx" <- w3
  # Transmitter
  # Receiver
  call "niUSRP Open Rx Session.gvi"(device names=$"device names") -> (session handle out=w4, error out=w5)
  call "niUSRP Configure Signal.gvi"(active antenna=$"active antenna Rx", session handle=w4, error in=w5, IQ rate=$"IQ rate", carrier frequency=$"carrier frequency", gain=$"gain Rx") -> (session handle out=w6, error out=w7, coerced carrier frequency=w8)
  Subtract(x=w8, y=20000) -> w9
  Property Node(instance in=w6, "niUSRP"=w9) -> (instance out=w10)
  call "niUSRP Initiate.gvi"(session handle=w10, error in=w7) -> (session handle out=w11, error out=w12)
  call "niUSRP Fetch Rx Data (CDB).gvi"(session handle=w11, error in=w12, number of samples=1000000) -> (session handle out=w13, error out=w14)
  call "niUSRP Close Session.gvi"(session handle=w13, error in=w14)
  call "niUSRP Open Tx Session.gvi"(device names=$"device names") -> (session handle out=w15, error out=w16)
  call "niUSRP Configure Signal.gvi"(active antenna=$"active antenna Tx", session handle=w15, error in=w16, IQ rate=$"IQ rate", carrier frequency=$"carrier frequency", gain=$"gain Tx") -> (session handle out=w17, error out=w18)
  call "MT Generate Bits (Galois, PN Order).gvi"(total bits=$"total bits") -> (output bit stream=w19)
  Array Size(array=w19) -> (size(s)=w20)
  s1 = uninitialised  # shift register
  for (N = w20) (iteration -> i1) {
    w21 = each element of w19
    Is Equal(x=w21, y=1) -> w22
    Select(s=w22, t=w21, f=-1) -> w23
    Insert Into Array(inArray=s1, index0=i1, new=w23) -> w24
    next s1 = w24
  }
  To Double Precision Float(number=s1) -> w25
  call "AddFrameHeader.gvi"(array=w25) -> (output array=w26)
  call "Upsample (DBL).gvi"(signal=w26, upsampling factor=20) -> (upsampled signal=w27)
  call "MT Generate Filter Coefficients.gvi"(pulse shaping filter="Root Raised Cos", pulse shaping samples per symbol=20, modulation type="PSK") -> (pulse shaping filter coefficients=w28)
  call "1D Convolution (DBL).gvi"(x=w27, y=w28) -> (x * y=w29)
  call "Quick Scale 1D.gvi"(X=w29) -> (Y[i]=X[i]/Max|X|=w30)
  Real And Imaginary To Complex(x=w30, y=0) -> w31
  Build Waveform Node(Y=w31, dt=5e-06) -> (output waveform=w32)
  call "Insert Pilots.gvi"(signal input=w32) -> (output signal=w33)
  call "AddFrameHeader (complex).gvi"(array=w33) -> (output array=w34)
  while {
    call "niUSRP Write Tx Data (CDB).gvi"(session handle=w17, error in=w18, data=w34) -> (session handle out=w35, error out=w36)
    stop if $"stop Tx"
  }
  call "niUSRP Close Session.gvi"(session handle=w35, error in=w36)
  $"Baseband Waveform" <- w32
  w37 = cluster{"t0": timestamp, "dt": f64, "Y": c128[]} {all zero or empty}
  Property Node(instance in=w37, "dt"=5e-06, "Y"=w31) -> (instance out=w38)
  call "FFT Power Spectrum for 1 Chan (CDB)2.gvi"(time signal=w38, dB On (F)=TRUE) -> (power spectrum=w39)
  $"Baseband Power Spectrum_Tx" <- w39
